# Grasshopper definition 3D.gh (Grasshopper 1.0.7)
# plug-ins: GhPotrace [ShapeDiver Compatible Version], BitmapComponent

import_3dm = Import3DM(Layer="*", Name="*")
point = Point(<point referenced from the Rhino model>)
brep = Brep(<brep referenced from the Rhino model>)
number_slider = Slider(1024, range=0..10000)
panel = Panel("先缩放后移动，注意顺序")
move = Move(Motion=point)  # -> Geometry, Transform
rectangle = Rectangle(Plane=PlaneXY(0, 0, 0), XSize=number_slider, YSize=number_slider, Radius=0)  # -> Rectangle, Length
scale = Scale(Center=Point(0, 0, 0), Factor=0.5)  # -> Geometry, Transform
rec = Rectangle(rectangle.Rectangle)
len = Length(Curve=rec)
brep_2 = Brep(move.Geometry)
multiplication = Multiplication(A=len, B=Slider(0.5, range=0..1))
compound = Compound(Transforms=[scale.Transform, move.Transform])
divlength = DivideLength(Curve=rec, Length=multiplication)  # -> Points, Tangents, Parameters
pt = Point(divlength.Points)
shift = ShiftList(List=pt, Shift=1, Wrap=True)
transform = Transform(Geometry=brep, Transform=compound)
ln = Line(StartPoint=pt, EndPoint=shift)
connect = ConnectCurves(Curves=ln, Continuity=2, Close=True, Bulge=1)
curvepoint = PointOnCurve(connect, parameter=0.253)
pt_2 = Point(curvepoint)

cluster = Cluster()
image = ImageSampler(Filter="Colour", Interpolate=False, Umax=1, Umin=0, Vmax=1, Vmin=0, Wrap=1)  # disabled
bmp = Bitmap(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)
bmp_2 = Bitmap(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)
col = Colour("0,1,0")
rooster = Rooster(
    ImageBitmap=bmp,
    Threshold=Slider(22, range=0..100),
    CornerThreshold=Slider(0.8, range=0..1),
    MaxTurdArea=Slider(2.5, range=0..10),
    Optimize=Toggle(False),
    Tolerance=Slider(0.2, range=0..1),
    Invert=Toggle(False),
    ColorCount=Slider(5, range=0..10),
    RoosterOutputMode=True,
    RoosterTurnPolicy=0)  # -> Curves, Boundary, Colors
crv = Curve(rooster.Curves)
panel_2 = Panel(rooster.Colors)
panel_3 = Panel("水")
panel_4 = Panel(crv)
explode = Explode(Recursive=True)  # -> Segments, Vertices
cluster_2 = Cluster(edges=explode.Segments)
construct_path = ConstructPath(Indices=Slider(4, range=0..100))
tree_branch = TreeBranch(Tree=rooster.Curves, Path=construct_path, MaintainPaths=True)
curve = Curve(cluster_2)
curve_2 = Curve(tree_branch)
panel_5 = Panel("""桥，水面，草地直接挤出
山是给2D图片挤出
noise干扰
亭子直接scale""")

panel_6 = Panel("廊")
construct_path_2 = ConstructPath(Indices=Slider(1, range=0..100))
tree_branch_2 = TreeBranch(Tree=rooster.Curves, Path=construct_path_2, MaintainPaths=True)
panel_7 = Panel("草地")
curve_3 = Curve(tree_branch_2)
panel_8 = Panel("建筑（留空）")
construct_path_3 = ConstructPath(Indices=Slider(3, range=0..100))
rebuild_curve = RebuildCurve(Curve=curve_3, Count=Slider(200, range=0..1000), Tangents=False)
panel_10 = Panel("廊子密度")
tree_branch_3 = TreeBranch(Tree=rooster.Curves, Path=construct_path_3, MaintainPaths=True)
construct_path_4 = ConstructPath(Indices=Slider(2, range=0..100))
number_slider_2 = Slider(10, range=0..10)
panel_11 = Panel("路")
boundary_surfaces = BoundarySurfaces(Edges=rebuild_curve)
curve_4 = Curve(tree_branch_3)
construct_path_5 = ConstructPath(Indices=Slider(25, range=0..100))
divide_distance = DivideDistance(Curve=rebuild_curve, Distance=Slider(40, range=0..100))  # -> Points, Tangents, Parameters
tree_branch_4 = TreeBranch(Tree=rooster.Curves, Path=construct_path_4, MaintainPaths=True)
boundary_surfaces_2 = BoundarySurfaces(Edges=rebuild_curve)
number_slider_3 = Slider(37, range=0..100)
rebuild_curve_2 = RebuildCurve(Curve=curve_4, Count=Slider(200, range=0..1000), Tangents=False)
construct_path_6 = ConstructPath(Indices=Slider(0, range=0..100))
tree_branch_5 = TreeBranch(Tree=rooster.Curves, Path=construct_path_5, MaintainPaths=True)
unit_z = UnitZ(Factor=1)
curve_5 = Curve(tree_branch_4)
unit_z_2 = UnitZ(Factor=Slider(1, range=0..10))
unit_z_3 = UnitZ(Factor=Slider(2, range=0..10))
boundary_surfaces_3 = BoundarySurfaces(Edges=rebuild_curve_2)
unit_z_4 = UnitZ(Factor=Slider(4, range=0..10))
tree_branch_6 = TreeBranch(Tree=rooster.Curves, Path=construct_path_6, MaintainPaths=True)
curve_6 = Curve(tree_branch_5)
rebuild_curve_3 = RebuildCurve(Curve=curve_5, Count=Slider(200, range=0..1000), Tangents=False)
line_sdl = LineSDL(Start=divide_distance.Points, Direction=unit_z, Length=number_slider_3)
unit_z_5 = UnitZ(Factor=number_slider_3)
extrude = Extrude(Base=boundary_surfaces, Direction=unit_z_2)
curve_7 = Curve(tree_branch_6)
rebuild_curve_4 = RebuildCurve(Curve=curve_2, Count=Slider(200, range=0..1000), Tangents=False)
rebuild_curve_5 = RebuildCurve(Curve=curve_6, Count=Slider(200, range=0..1000), Tangents=False)
boundary_surfaces_4 = BoundarySurfaces(Edges=rebuild_curve_3)
unit_z_6 = UnitZ(Factor=Slider(20, range=1..21))
rebuild_curve_6 = RebuildCurve(Curve=curve_7, Count=Slider(200, range=0..1000), Tangents=False)
unit_z_7 = UnitZ(Factor=number_slider_2)
move_2 = Move(Geometry=extrude, Motion=unit_z_5)  # -> Geometry, Transform
unit_z_8 = UnitZ(Factor=number_slider_2)
boundary_surfaces_5 = BoundarySurfaces(Edges=rebuild_curve_4)
pipe = Pipe(Curve=line_sdl, Radius=1, Caps=2)
boundary_surfaces_6 = BoundarySurfaces(Edges=rebuild_curve_5)
unit_z_9 = UnitZ(Factor=Slider(20, range=1..21))
unit_z_10 = UnitZ(Factor=number_slider_2)
boundary_surfaces_7 = BoundarySurfaces(Edges=rebuild_curve_6)
extrude_2 = Extrude(Base=boundary_surfaces_2, Direction=unit_z_3)
extrude_3 = Extrude(Base=boundary_surfaces_4, Direction=unit_z_6)
unit_z_11 = UnitZ(Factor=Slider(20, range=0..100))
panel_12 = Panel("廊子垫高")
extrude_4 = Extrude(Base=boundary_surfaces_2, Direction=unit_z_8)
extrude_5 = Extrude(Base=boundary_surfaces_3, Direction=unit_z_4)
extrude_6 = Extrude(Base=boundary_surfaces_5, Direction=unit_z_7)
extrude_7 = Extrude(Base=boundary_surfaces_6, Direction=unit_z_9)
extrude_8 = Extrude(Base=boundary_surfaces_7, Direction=unit_z_11)
brep_3 = Brep([extrude_2, move_2.Geometry, pipe])
extrude_9 = Extrude(Base=[pipe, move_2.Geometry, extrude_2], Direction=unit_z_10)  # -> flatten(Extrusion)
move_3 = Move(Geometry=brep_3, Motion=unit_z_10)  # -> Geometry, Transform
brep_4 = Brep([extrude_5, extrude_3, extrude_6, extrude_8, extrude_4, move_3.Geometry, extrude_7])
panel_13 = Panel(extrude_9)

# ==== cluster Cluster
edges = ClusterInput()
boundary_surfaces = BoundarySurfaces(Edges=edges)
deconstruct_brep = DeconstructBrep(Brep=boundary_surfaces)  # -> Faces, Edges, Vertices
curve = Curve(deconstruct_brep.Edges)
length = Length(Curve=curve)
larger_than = LargerThan(FirstNumber=length, SecondNumber=Slider(200, range=0..1000))  # -> LargerThan, OrEqualTo
cull_pattern = CullPattern(List=curve, CullPattern=larger_than.LargerThan)
list_length = ListLength(List=cull_pattern)
subtraction = Subtraction(A=list_length, B=1)
construct_domain = ConstructDomain(DomainStart=1, DomainEnd=subtraction)
list_item = ListItem(List=cull_pattern, Index=0, Wrap=True)
sub_list = SubList(List=cull_pattern, Domain=construct_domain, Wrap=True)  # -> List, Index
range = Range(Domain=Domain(0, 1), Steps=Slider(37, range=0..100))
flip_curve = FlipCurve(Curve=sub_list.List, Guide=list_item)  # -> Curve, Flag
merge = Merge(Data1=list_item, Data2=flip_curve.Curve)  # -> flatten(Result)
evaluate_curve = EvaluateCurve(Curve=reparameterize(graft(merge)), Parameter=range)  # -> Point, Tangent, Angle
flip_matrix = FlipMatrix(Data=evaluate_curve.Point)
average = Average(Input=flip_matrix)  # -> flatten(ArithmeticMean)
interpolate = Interpolate(Vertices=average, Degree=3, Periodic=False, KnotStyle=1)  # -> Curve, Length, Domain
curve_2 = ClusterOutput(interpolate.Curve)
